# Grasshopper definition LeafGenerator.gh (Grasshopper 1.0.8)
# plug-ins: GH_MCP

grasshopper_mcp = GrasshopperMCP(Enabled=True, Port=8080)  # -> Status, LastCommand
py3 = Python3Script(
    height_total_m=Slider(14, range=5..15),
    landing_radius_m=Slider(1.2, range=0.5..3),
    twist_total_deg=Slider(60, range=-180..180),
    candidate_id="cand_phaseb_e2e")  # -> out, a, b, c; inputs height_total_m: Double, landing_radius_m: Double, twist_total_deg: Double, candidate_id: String
# ---------- py3: Python ----------
# r: trimesh
import sys, pathlib, json
REPO_ROOT = pathlib.Path(r"C:\Users\user\Documents\LFTH_CFD")
if str(REPO_ROOT) not in sys.path:
    sys.path.insert(0, str(REPO_ROOT))

from gh.scripts.leaf_generator import build_mvp_mesh, build_params_dict
import Rhino.Geometry as rg

verts, faces = build_mvp_mesh(height_total_m, landing_radius_m, twist_total_deg)
params_dict = build_params_dict(candidate_id, height_total_m, landing_radius_m, twist_total_deg)

mesh = rg.Mesh()
for v in verts:
    mesh.Vertices.Add(v[0], v[1], v[2])
for f in faces:
    mesh.Faces.AddFace(f[0], f[1], f[2])
mesh.Normals.ComputeNormals()
mesh.Compact()

a = mesh
b = json.dumps(params_dict)
c = candidate_id
# ---------- end py3 ----------
py3_2 = Python3Script(mesh=py3.a, params_dict=py3.b, candidate_id=py3.c)  # -> out, a; inputs mesh: Mesh, candidate_id: String
# ---------- py3_2: Python ----------
# r: trimesh
import sys, pathlib, json
REPO_ROOT = pathlib.Path(r"C:\Users\user\Documents\LFTH_CFD")
if str(REPO_ROOT) not in sys.path:
    sys.path.insert(0, str(REPO_ROOT))

from gh.scripts.export_candidate import export_candidate

params_dict = json.loads(params_dict)

verts = [(v.X, v.Y, v.Z) for v in mesh.Vertices]
faces = []
for f in mesh.Faces:
    if f.IsQuad:
        faces.append((f.A, f.B, f.C))
        faces.append((f.A, f.C, f.D))
    else:
        faces.append((f.A, f.B, f.C))

out_dir = REPO_ROOT / "runs" / candidate_id
summary = export_candidate(verts, faces, params_dict, out_dir)

a = "OK | {} | tri={} | vert={}".format(
    summary["stl_path"], summary["triangle_count"], summary["vertex_count"]
)
# ---------- end py3_2 ----------
panel = Panel(py3_2.a)
